# Grasshopper definition dynamic_geometry.gh (Grasshopper 1.0.7)

# ----
# Use Aperture component to create
# static windows.
panel = Panel("custom_glass")
glassmod = HBGlassModifier(name=panel, trans="0.65")  # -> modifier; plug-in component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
brep = Brep([<brep referenced from the Rhino model> x12])
aperture = HBAperture(geo=brep, name="static_window", rad_mod=glassmod)  # -> report, apertures; plug-in component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

# ---- group: Opaque Faces
geo = Geometry([<brep referenced from the Rhino model> x23])
roomsolid = HBRoomFromSolid(geo=flatten(geo), name="Room", conditioned=True)  # -> report, rooms; plug-in component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

# ---- group: Electrochromic states
glassmod_2 = HBGlassModifier(name="Tint_1", trans="0.12")  # -> modifier; plug-in component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
glassmod_3 = HBGlassModifier(name="Tint_0", trans="0.4")  # -> modifier; plug-in component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
state = HBDynamicState(modifier=glassmod_2)  # -> state; plug-in component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
state_2 = HBDynamicState(modifier=glassmod_3)  # -> state; plug-in component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
merge = Merge(Data1=state_2, Data2=state)

# ---- group: class_room
geo_2 = Geometry(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)

# ---- group: office
geo_3 = Geometry(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)

# ---- group: Context!
brep_2 = Brep(<brep referenced from the Rhino model>)
shade = HBShade(geo=brep_2)  # -> report, shades; plug-in component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

# ----
# Use Aperture component to create
# static windows.
panel_2 = Panel("custom_glass")
glassmod_4 = HBGlassModifier(name=panel_2, trans="0.65")  # -> modifier; plug-in component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
brep_3 = Brep(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)
aperture_2 = HBAperture(geo=brep_3, name="north_window", rad_mod=glassmod_4)  # -> report, apertures; plug-in component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

brep_4 = Brep(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)
aperture_3 = HBAperture(geo=brep_4, name="EC_Aperture")  # -> report, apertures; plug-in component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
aperturegroup = HBDynamicApertureGroup(apertures=aperture_3.apertures, name="Electrochromic_Windows", states=merge)  # -> group_aps; plug-in component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

# ---- group: Electrochromic states
glassmod_5 = HBGlassModifier(name="Tint_1", trans="0.12")  # -> modifier; plug-in component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
glassmod_6 = HBGlassModifier(name="Tint_0", trans="0.4")  # -> modifier; plug-in component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
state_3 = HBDynamicState(modifier=glassmod_5)  # -> state; plug-in component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
state_4 = HBDynamicState(modifier=glassmod_6)  # -> state; plug-in component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
merge_2 = Merge(Data1=state_4, Data2=state_3)

# ----
# Use the Dynamic Aperture Group component
# to create dynamic apertures. When using
# BSDF modifiers, all of the apertures
# in each group must point in the same
# direction.
panel_3 = Panel("EC_Aperture")
brep_5 = Brep([<brep referenced from the Rhino model> x11])
aperture_4 = HBAperture(geo=brep_5, name=panel_3)  # -> report, apertures; plug-in component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
aperturegroup_2 = HBDynamicApertureGroup(apertures=aperture_4.apertures, name="EC_ApertureGroup", states=merge_2)  # -> group_aps; plug-in component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

# ---- group: skylight_1
brep_6 = Brep(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)

# ----
skylight_2 = Brep(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)

# ---- group: Opaque Faces
panel_4 = Panel("""class_room
office""")
roomsolid_2 = HBRoomFromSolid(geo=flatten([geo_2, geo_3]), name=panel_4, conditioned=True)  # -> report, rooms; plug-in component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

# ---- group: Context!
brep_7 = Brep([<brep referenced from the Rhino model> x15])
shade_2 = HBShade(geo=brep_7)  # -> report, shades; plug-in component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

# ---- group: Opaque Faces
geo_4 = Geometry([<brep referenced from the Rhino model> x23])
roomsolid_3 = HBRoomFromSolid(geo=flatten(geo_4), name="Room", conditioned=True)  # -> report, rooms; plug-in component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

# ---- group: class_room
geo_5 = Geometry(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)

# ---- group: office
geo_6 = Geometry(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)

# ---- group: Context!
brep_8 = Brep(<brep referenced from the Rhino model>)
shade_3 = HBShade(geo=brep_8)  # -> report, shades; plug-in component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

brep_9 = Brep([<brep referenced from the Rhino model> x15])
shade_4 = HBShade(geo=brep_9)  # -> report, shades; plug-in component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

# ---- group: Opaque Faces
panel_5 = Panel("""class_room
office""")
roomsolid_4 = HBRoomFromSolid(geo=flatten([geo_5, geo_6]), name=panel_5, conditioned=True)  # -> report, rooms; plug-in component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

# ----
# Simple scene
python = GhPythonScript()  # -> a
# ---------- python: Python ----------
import os
a = os.path.dirname(ghenv.Component.OnPingDocument().FilePath) + r'\xmls\\'
# ---------- end python ----------
panel_6 = Panel(python)
panel_7 = Panel(python)
east_window_office = Brep(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)
east_window_classroom = Brep(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)
concat = Concatenate(FragmentA=panel_7, FragmentB="clear.xml")
concat_2 = Concatenate(FragmentA=panel_7, FragmentB="diffuse50.xml")
concat_3 = Concatenate(FragmentA=panel_6, FragmentB="clear.xml")
concat_4 = Concatenate(FragmentA=panel_6, FragmentB="diffuse50.xml")
bsdfmod = HBBSDFModifier(xml_file=concat)  # -> modifier; plug-in component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
bsdfmod_2 = HBBSDFModifier(xml_file=concat_2)  # -> modifier; plug-in component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
bsdfmod_3 = HBBSDFModifier(xml_file=concat_4)  # -> modifier; plug-in component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
bsdfmod_4 = HBBSDFModifier(xml_file=concat_3)  # -> modifier; plug-in component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
state_5 = HBDynamicState(modifier=bsdfmod)  # -> state; plug-in component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
state_6 = HBDynamicState(modifier=bsdfmod_2)  # -> state; plug-in component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
state_7 = HBDynamicState(modifier=bsdfmod_4)  # -> state; plug-in component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
state_8 = HBDynamicState(modifier=bsdfmod_3)  # -> state; plug-in component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
merge_3 = Merge(Data1=state_5, Data2=state_6)
merge_4 = Merge(Data1=state_7, Data2=state_8)
pt = ConstructPoint(XCoordinate="5", YCoordinate=0, ZCoordinate=0)
legendpar = LBLegendParameters(base_plane=pt, seg_height="2")  # -> leg_par; plug-in component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
python_2 = GhPythonScript()  # -> a
# ---------- python_2: Python ----------
import os
a = os.path.dirname(ghenv.Component.OnPingDocument().FilePath) + r'\multi-phase-dev\three-phase-simple'
# ---------- end python_2 ----------
panel_8 = Panel(python_2)

panel_9 = Panel("""skylight_1
skylight_2""")
aperture_5 = HBAperture(geo=[brep_6, skylight_2], name=panel_9)  # -> report, apertures; plug-in component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
aperturegroup_3 = HBDynamicApertureGroup(apertures=simplify(graft(aperture_5.apertures)), name=simplify(graft(panel_9)), states=merge_3)  # -> flatten(group_aps); plug-in component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

panel_10 = Panel("""east_window_classroom
east_window_office""")
aperture_6 = HBAperture(geo=[east_window_classroom, east_window_office], name=panel_10)  # -> report, apertures; plug-in component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
aperturegroup_4 = HBDynamicApertureGroup(apertures=simplify(graft(aperture_6.apertures)), name=simplify(graft(panel_10)), states=merge_4)  # -> flatten(group_aps); plug-in component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

addsubface = HBAddSubface(
    hb_obj=flatten(roomsolid_2.rooms),
    sub_faces=flatten([aperture_2.apertures, aperturegroup, aperturegroup_3, aperturegroup_4]))  # -> hb_obj; plug-in component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
bordershades = HBExtrudedBorderShades(hb_objs=flatten(addsubface), depth="0.3")  # -> report, hb_objs; plug-in component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

# ----
# Complex scene
python_3 = GhPythonScript()  # -> a; same code as python
panel_11 = Panel(python_3)
concat_5 = Concatenate(FragmentA=panel_11, FragmentB="clear.xml")
concat_6 = Concatenate(FragmentA=panel_11, FragmentB="diffuse50.xml")
bsdfmod_5 = HBBSDFModifier(xml_file=concat_6)  # -> modifier; plug-in component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
bsdfmod_6 = HBBSDFModifier(xml_file=concat_5)  # -> modifier; plug-in component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
state_9 = HBDynamicState(modifier=bsdfmod_6)  # -> state; plug-in component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
state_10 = HBDynamicState(modifier=bsdfmod_5)  # -> state; plug-in component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
merge_5 = Merge(Data1=state_9, Data2=state_10)
pt_2 = ConstructPoint(XCoordinate="5", YCoordinate=0, ZCoordinate=0)
legendpar_2 = LBLegendParameters(base_plane=pt_2, seg_height="2")  # -> leg_par; plug-in component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
python_4 = GhPythonScript()  # -> a
# ---------- python_4: Python ----------
import os
a = os.path.dirname(ghenv.Component.OnPingDocument().FilePath) + r'\multi-phase-dev\three-phase-complex'
# ---------- end python_4 ----------
panel_12 = Panel(python_4)

brep_10 = Brep([<brep referenced from the Rhino model> x41])
aperture_7 = HBAperture(geo=brep_10, name="aperture")  # -> report, apertures; plug-in component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
python_5 = GhPythonScript(aperture=aperture_7.apertures)  # -> name
# ---------- python_5: Python ----------
name = aperture.display_name
# ---------- end python_5 ----------
aperturegroup_5 = HBDynamicApertureGroup(apertures=simplify(graft(aperture_7.apertures)), name=simplify(graft(python_5)), states=merge_5)  # -> flatten(group_aps); plug-in component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

addsubface_2 = HBAddSubface(hb_obj=flatten(roomsolid.rooms), sub_faces=flatten([aperture.apertures, aperturegroup_5, aperturegroup_2]))  # -> hb_obj; plug-in component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
bordershades_2 = HBExtrudedBorderShades(hb_objs=flatten(addsubface_2), depth="0.3")  # -> report, hb_objs; plug-in component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

gridrooms = HBSensorGridFromRooms(rooms=addsubface_2, grid_size="1.0", dist_floor="0.8")  # -> grid, points, mesh; plug-in component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

# ----
# Model
panel_13 = Panel("three-phase-complex")
model = HBModel(rooms=flatten(bordershades_2.hb_objs), shades=flatten(shade_2.shades), name=panel_13)  # -> report, model; plug-in component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
assigngridsviews = HBAssignGridsAndViews(model=model.model, grids=flatten(gridrooms.grid))  # -> model; plug-in component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

# ----
# Visualize Model
roomattr = HBRoomAttributes({"Display Name": "display_name", "Simulation Name (Identifier)": "identifier", "Multiplier": "multiplier", "Story": "story", "Volume": "volume", "Gross Floor Area": "floor_area", "Exposed Area": "exposed_area", "Exterior Wall Area": "exterior_wall_area", "Exterior Aperture Area": "exterior_aperture_area", "Average Floor Elevation": "average_floor_height"}, selected="Display Name")
faceradianceattr = HBFaceEnergyAttributes({"Modifier": "properties.radiance.modifier.display_name", "Modifier Blk": "properties.radiance.modifier_blk.display_name", "Is Opaque": "properties.radiance.is_opaque", "Dynamic Group": "properties.radiance.dynamic_group_identifier", "State Count": "properties.radiance.state_count", "States": "properties.radiance.states"}, selected="Dynamic Group")
colorroomattr = HBColorRoomAttributes(rooms_model=flatten(assigngridsviews), attribute=roomattr, legend_par=legendpar_2)  # -> mesh, legend, wire_frame, values, colors, vis_set; plug-in component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
colorfaceattr = HBColorFaceAttributes(hb_objs=flatten(assigngridsviews), attribute=faceradianceattr, legend_par=legendpar_2)  # -> mesh, legend, wire_frame, values, colors, vis_set; plug-in component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

vizwiref = HBVisualizeWireframe(hb_objs=flatten(assigngridsviews))  # -> geo; plug-in component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
modeltohbjson = GhPythonScript(model=assigngridsviews, folder=panel_12, write=Toggle(False))  # inputs write: Boolean
# ---------- modeltohbjson: Python ----------
if write and folder is not None:
    model.to_hbjson(folder=folder)
# ---------- end modeltohbjson ----------

# ----
# Write
# Radiance
# Model Folder
modeltorad = HBModelToRadFolder(model=assigngridsviews, folder=python_4, write=Toggle(False))  # -> report, folder; plug-in component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
opendir = LBOpenDirectory(file_path=modeltorad.folder)  # -> report; disabled; plug-in component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

gridrooms_2 = HBSensorGridFromRooms(rooms=addsubface, grid_size="1.0", dist_floor="0.8")  # -> grid, points, mesh; plug-in component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

# ----
# Model
panel_14 = Panel("three-phase-simple")
model_2 = HBModel(rooms=flatten(bordershades.hb_objs), shades=flatten(shade.shades), name=panel_14)  # -> report, model; plug-in component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
assigngridsviews_2 = HBAssignGridsAndViews(model=model_2.model, grids=flatten(gridrooms_2.grid))  # -> model; plug-in component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

# ----
# Visualize Model
roomattr_2 = HBRoomAttributes({"Display Name": "display_name", "Simulation Name (Identifier)": "identifier", "Multiplier": "multiplier", "Story": "story", "Volume": "volume", "Gross Floor Area": "floor_area", "Exposed Area": "exposed_area", "Exterior Wall Area": "exterior_wall_area", "Exterior Aperture Area": "exterior_aperture_area", "Average Floor Elevation": "average_floor_height"}, selected="Display Name")
faceradianceattr_2 = HBFaceEnergyAttributes({"Modifier": "properties.radiance.modifier.display_name", "Modifier Blk": "properties.radiance.modifier_blk.display_name", "Is Opaque": "properties.radiance.is_opaque", "Dynamic Group": "properties.radiance.dynamic_group_identifier", "State Count": "properties.radiance.state_count", "States": "properties.radiance.states"}, selected="Dynamic Group")
colorroomattr_2 = HBColorRoomAttributes(rooms_model=flatten(assigngridsviews_2), attribute=roomattr_2, legend_par=legendpar)  # -> mesh, legend, wire_frame, values, colors, vis_set; plug-in component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
colorfaceattr_2 = HBColorFaceAttributes(hb_objs=flatten(assigngridsviews_2), attribute=faceradianceattr_2, legend_par=legendpar)  # -> mesh, legend, wire_frame, values, colors, vis_set; plug-in component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

vizwiref_2 = HBVisualizeWireframe(hb_objs=flatten(assigngridsviews_2))  # -> geo; plug-in component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
modeltohbjson_2 = GhPythonScript(model=assigngridsviews_2, folder=panel_8, write=Toggle(False))  # inputs write: Boolean; same code as modeltohbjson

# ----
# Write
# Radiance
# Model Folder
modeltorad_2 = HBModelToRadFolder(model=assigngridsviews_2, folder=python_2, write=Toggle(False))  # -> report, folder; plug-in component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
opendir_2 = LBOpenDirectory(file_path=modeltorad_2.folder)  # -> report; disabled; plug-in component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

# ----
# Complex scene, BSDF only
python_6 = GhPythonScript()  # -> a; same code as python
panel_15 = Panel(python_6)
concat_7 = Concatenate(FragmentA=panel_15, FragmentB="clear.xml")
concat_8 = Concatenate(FragmentA=panel_15, FragmentB="diffuse50.xml")
bsdfmod_7 = HBBSDFModifier(xml_file=concat_8)  # -> modifier; plug-in component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
bsdfmod_8 = HBBSDFModifier(xml_file=concat_7)  # -> modifier; plug-in component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
state_11 = HBDynamicState(modifier=bsdfmod_8)  # -> state; plug-in component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
state_12 = HBDynamicState(modifier=bsdfmod_7)  # -> state; plug-in component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
merge_6 = Merge(Data1=state_11, Data2=state_12)
pt_3 = ConstructPoint(XCoordinate="5", YCoordinate=0, ZCoordinate=0)
legendpar_3 = LBLegendParameters(base_plane=pt_3, seg_height="2")  # -> leg_par; plug-in component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
python_7 = GhPythonScript()  # -> a
# ---------- python_7: Python ----------
import os
a = os.path.dirname(ghenv.Component.OnPingDocument().FilePath) + r'\multi-phase-dev\three-phase-complex-bsdf_only'
# ---------- end python_7 ----------
panel_16 = Panel(python_7)

brep_11 = Brep([<brep referenced from the Rhino model> x64])
aperture_8 = HBAperture(geo=brep_11, name="aperture")  # -> report, apertures; plug-in component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
python_8 = GhPythonScript(aperture=aperture_8.apertures)  # -> name; same code as python_5
aperturegroup_6 = HBDynamicApertureGroup(apertures=simplify(graft(aperture_8.apertures)), name=simplify(graft(python_8)), states=merge_6)  # -> flatten(group_aps); plug-in component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

addsubface_3 = HBAddSubface(hb_obj=flatten(roomsolid_3.rooms), sub_faces=flatten(aperturegroup_6))  # -> hb_obj; plug-in component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
bordershades_3 = HBExtrudedBorderShades(hb_objs=flatten(addsubface_3), depth="0.3")  # -> report, hb_objs; plug-in component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

# ----
# Simple scene, BSDF only
python_9 = GhPythonScript()  # -> a; same code as python
panel_17 = Panel(python_9)
concat_9 = Concatenate(FragmentA=panel_17, FragmentB="clear.xml")
concat_10 = Concatenate(FragmentA=panel_17, FragmentB="diffuse50.xml")
bsdfmod_9 = HBBSDFModifier(xml_file=concat_10)  # -> modifier; plug-in component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
bsdfmod_10 = HBBSDFModifier(xml_file=concat_9)  # -> modifier; plug-in component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
state_13 = HBDynamicState(modifier=bsdfmod_10)  # -> state; plug-in component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
state_14 = HBDynamicState(modifier=bsdfmod_9)  # -> state; plug-in component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
merge_7 = Merge(Data1=state_13, Data2=state_14)
pt_4 = ConstructPoint(XCoordinate="5", YCoordinate=0, ZCoordinate=0)
legendpar_4 = LBLegendParameters(base_plane=pt_4, seg_height="2")  # -> leg_par; plug-in component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
python_10 = GhPythonScript()  # -> a
# ---------- python_10: Python ----------
import os
a = os.path.dirname(ghenv.Component.OnPingDocument().FilePath) + r'\multi-phase-dev\three-phase-simple-bsdf_only'
# ---------- end python_10 ----------
panel_18 = Panel(python_10)

skylight_2_2 = Brep(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)
skylight_1 = Brep(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)
panel_19 = Panel("""skylight_1
skylight_2""")
aperture_9 = HBAperture(geo=[skylight_1, skylight_2_2], name=panel_19)  # -> report, apertures; plug-in component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
aperturegroup_7 = HBDynamicApertureGroup(apertures=simplify(graft(aperture_9.apertures)), name=simplify(graft(panel_19)), states=merge_7)  # -> flatten(group_aps); plug-in component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

east_window_classroom_2 = Brep(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)
east_window_office_2 = Brep(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)
panel_20 = Panel("""east_window_classroom
east_window_office""")
aperture_10 = HBAperture(geo=[east_window_classroom_2, east_window_office_2], name=panel_20)  # -> report, apertures; plug-in component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
aperturegroup_8 = HBDynamicApertureGroup(apertures=simplify(graft(aperture_10.apertures)), name=simplify(graft(panel_20)), states=merge_7)  # -> flatten(group_aps); plug-in component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

brep_12 = Brep(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)
aperture_11 = HBAperture(geo=brep_12, name="south_window")  # -> report, apertures; plug-in component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
aperturegroup_9 = HBDynamicApertureGroup(apertures=aperture_11.apertures, name="south_window", states=merge_7)  # -> group_aps; plug-in component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

brep_13 = Brep(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)
aperture_12 = HBAperture(geo=brep_13, name="north_window")  # -> report, apertures; plug-in component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
aperturegroup_10 = HBDynamicApertureGroup(apertures=aperture_12.apertures, name="north_window", states=merge_7)  # -> group_aps; plug-in component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

addsubface_4 = HBAddSubface(
    hb_obj=flatten(roomsolid_4.rooms),
    sub_faces=flatten([aperturegroup_9, aperturegroup_7, aperturegroup_8, aperturegroup_10]))  # -> hb_obj; plug-in component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
bordershades_4 = HBExtrudedBorderShades(hb_objs=flatten(addsubface_4), depth="0.3")  # -> report, hb_objs; plug-in component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

gridrooms_3 = HBSensorGridFromRooms(rooms=addsubface_3, grid_size="1.0", dist_floor="0.8")  # -> grid, points, mesh; plug-in component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

# ----
# Model
panel_21 = Panel("three-phase-complex-bsdf_only")
model_3 = HBModel(rooms=flatten(bordershades_3.hb_objs), shades=flatten(shade_4.shades), name=panel_21)  # -> report, model; plug-in component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
assigngridsviews_3 = HBAssignGridsAndViews(model=model_3.model, grids=flatten(gridrooms_3.grid))  # -> model; plug-in component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

# ----
# Visualize Model
roomattr_3 = HBRoomAttributes({"Display Name": "display_name", "Simulation Name (Identifier)": "identifier", "Multiplier": "multiplier", "Story": "story", "Volume": "volume", "Gross Floor Area": "floor_area", "Exposed Area": "exposed_area", "Exterior Wall Area": "exterior_wall_area", "Exterior Aperture Area": "exterior_aperture_area", "Average Floor Elevation": "average_floor_height"}, selected="Display Name")
faceradianceattr_3 = HBFaceEnergyAttributes({"Modifier": "properties.radiance.modifier.display_name", "Modifier Blk": "properties.radiance.modifier_blk.display_name", "Is Opaque": "properties.radiance.is_opaque", "Dynamic Group": "properties.radiance.dynamic_group_identifier", "State Count": "properties.radiance.state_count", "States": "properties.radiance.states"}, selected="Dynamic Group")
colorroomattr_3 = HBColorRoomAttributes(rooms_model=flatten(assigngridsviews_3), attribute=roomattr_3, legend_par=legendpar_3)  # -> mesh, legend, wire_frame, values, colors, vis_set; plug-in component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
colorfaceattr_3 = HBColorFaceAttributes(hb_objs=flatten(assigngridsviews_3), attribute=faceradianceattr_3, legend_par=legendpar_3)  # -> mesh, legend, wire_frame, values, colors, vis_set; plug-in component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

vizwiref_3 = HBVisualizeWireframe(hb_objs=flatten(assigngridsviews_3))  # -> geo; plug-in component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
modeltohbjson_3 = GhPythonScript(model=assigngridsviews_3, folder=panel_16, write=Toggle(False))  # inputs write: Boolean; same code as modeltohbjson

# ----
# Write
# Radiance
# Model Folder
modeltorad_3 = HBModelToRadFolder(model=assigngridsviews_3, folder=python_7, write=Toggle(False))  # -> report, folder; plug-in component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
opendir_3 = LBOpenDirectory(file_path=modeltorad_3.folder)  # -> report; disabled; plug-in component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

gridrooms_4 = HBSensorGridFromRooms(rooms=addsubface_4, grid_size="1.0", dist_floor="0.8")  # -> grid, points, mesh; plug-in component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

# ----
# Model
panel_22 = Panel("three-phase-simple-bsdf_only")
model_4 = HBModel(rooms=flatten(bordershades_4.hb_objs), shades=flatten(shade_3.shades), name=panel_22)  # -> report, model; plug-in component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
assigngridsviews_4 = HBAssignGridsAndViews(model=model_4.model, grids=flatten(gridrooms_4.grid))  # -> model; plug-in component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

# ----
# Visualize Model
roomattr_4 = HBRoomAttributes({"Display Name": "display_name", "Simulation Name (Identifier)": "identifier", "Multiplier": "multiplier", "Story": "story", "Volume": "volume", "Gross Floor Area": "floor_area", "Exposed Area": "exposed_area", "Exterior Wall Area": "exterior_wall_area", "Exterior Aperture Area": "exterior_aperture_area", "Average Floor Elevation": "average_floor_height"}, selected="Display Name")
faceradianceattr_4 = HBFaceEnergyAttributes({"Modifier": "properties.radiance.modifier.display_name", "Modifier Blk": "properties.radiance.modifier_blk.display_name", "Is Opaque": "properties.radiance.is_opaque", "Dynamic Group": "properties.radiance.dynamic_group_identifier", "State Count": "properties.radiance.state_count", "States": "properties.radiance.states"}, selected="Dynamic Group")
colorroomattr_4 = HBColorRoomAttributes(rooms_model=flatten(assigngridsviews_4), attribute=roomattr_4, legend_par=legendpar_4)  # -> mesh, legend, wire_frame, values, colors, vis_set; plug-in component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
colorfaceattr_4 = HBColorFaceAttributes(hb_objs=flatten(assigngridsviews_4), attribute=faceradianceattr_4, legend_par=legendpar_4)  # -> mesh, legend, wire_frame, values, colors, vis_set; plug-in component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

vizwiref_4 = HBVisualizeWireframe(hb_objs=flatten(assigngridsviews_4))  # -> geo; plug-in component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
modeltohbjson_4 = GhPythonScript(model=assigngridsviews_4, folder=panel_18, write=Toggle(False))  # inputs write: Boolean; same code as modeltohbjson

# ----
# Write
# Radiance
# Model Folder
modeltorad_4 = HBModelToRadFolder(model=assigngridsviews_4, folder=python_10, write=Toggle(False))  # -> report, folder; plug-in component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
opendir_4 = LBOpenDirectory(file_path=modeltorad_4.folder)  # -> report; disabled; plug-in component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
