# Grasshopper definition sample_medium_grid.gh (Grasshopper 1.0.7)

brep = Brep([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])
item = ListItem(List=brep, Index=0, Wrap=True)  # -> Item, Item1, Item2, Item3, Item4, Item5, Item6
panel = Panel("""0.76
0.56""")

# ---- group: Opaque Faces
# Geometry Preparation
geo = Geometry([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])
roomsolid = HBRoomFromSolid(geo=flatten(geo), name="TestRoom", conditioned=True)  # -> report, rooms; plug-in component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

# ---- group: Context!
brep_2 = Brep([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])
shade = HBShade(geo=brep_2)  # -> report, shades; plug-in component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

# ----
panel_2 = Panel("""0.76
0.56""")
panel_3 = Panel("""0.76
0.56""")
panel_4 = Panel("""0.76
0.56""")
brep_3 = Brep(item.Item)
brep_4 = Brep(item.Item1)
glassmod = HBGlassModifier(name=panel, trans=panel)  # -> modifier; plug-in component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
brep_5 = Brep(item.Item2)
glassmod_2 = HBGlassModifier(name=panel_2, trans=panel_2)  # -> modifier; plug-in component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
brep_6 = Brep(item.Item3)
brep_7 = Brep([item.Item4, item.Item5])
glassmod_3 = HBGlassModifier(name=panel_3, trans=panel_3)  # -> modifier; plug-in component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
glassmod_4 = HBGlassModifier(name=panel_4, trans=panel_4)  # -> modifier; plug-in component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
glassmod_5 = HBGlassModifier(name="0.56_Skylight", trans="0.56")  # -> modifier; plug-in component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
brep_8 = Brep(item.Item6)
glassmod_6 = HBGlassModifier(name="0.76_Skylight", trans="0.76")  # -> modifier; plug-in component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
aperture = HBAperture(geo=brep_3, name="Room1_North")  # -> report, apertures; plug-in component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
aperture_2 = HBAperture(geo=brep_4, name="Room1_South")  # -> report, apertures; plug-in component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
aperture_3 = HBAperture(geo=brep_5, name="Room2_North1")  # -> report, apertures; plug-in component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
aperture_4 = HBAperture(geo=brep_6, name="Room2_North2")  # -> report, apertures; plug-in component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
aperture_5 = HBAperture(geo=brep_7, name="Room1_Skylight", rad_mod=glassmod_5)  # -> report, apertures; plug-in component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
state = HBDynamicState(modifier=glassmod)  # -> state; plug-in component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
aperture_6 = HBAperture(geo=brep_8, name="Room2_Skylight", rad_mod=glassmod_6)  # -> report, apertures; plug-in component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
state_2 = HBDynamicState(modifier=glassmod_2)  # -> state; plug-in component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
state_3 = HBDynamicState(modifier=glassmod_3)  # -> state; plug-in component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
state_4 = HBDynamicState(modifier=glassmod_4)  # -> state; plug-in component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
aperturegroup = HBDynamicApertureGroup(apertures=aperture.apertures, name="Room1_North", states=state)  # -> group_aps; plug-in component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
aperturegroup_2 = HBDynamicApertureGroup(apertures=aperture_2.apertures, name="Room1_South", states=state_2)  # -> group_aps; plug-in component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
aperturegroup_3 = HBDynamicApertureGroup(apertures=aperture_3.apertures, name="Room2_North1", states=state_3)  # -> group_aps; plug-in component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
aperturegroup_4 = HBDynamicApertureGroup(apertures=aperture_4.apertures, name="Room2_North2", states=state_4)  # -> group_aps; plug-in component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

# ---- group: Apertures
addsubface = HBAddSubface(
    hb_obj=flatten(roomsolid.rooms),
    sub_faces=flatten([aperturegroup, aperturegroup_2, aperturegroup_3, aperturegroup_4, aperture_5.apertures, aperture_6.apertures]))  # -> hb_obj; plug-in component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
bordershades = HBExtrudedBorderShades(hb_objs=flatten(addsubface), depth="0.3")  # -> report, hb_objs; plug-in component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

# ----
# Wea
panel_5 = Panel("https://energyplus-weather.s3.amazonaws.com/north_and_central_america_wmo_region_4/USA/MA/USA_MA_Boston-Logan.Intl.AP.725090_TMY3/USA_MA_Boston-Logan.Intl.AP.725090_TMY3.zip")
downloadepw = LBDownloadWeather(weather_URL=panel_5)  # -> epw_file, stat_file, ddy_file; plug-in component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
wea = HBWeaFromEPW(epw_file=downloadepw.epw_file)  # -> wea; plug-in component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

# ----
# Model + Grids
panel_6 = Panel("sample_medium_grid")
model = HBModel(rooms=flatten(bordershades.hb_objs), shades=flatten(shade.shades), name=panel_6)  # -> report, model; plug-in component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
gridrooms = HBSensorGridFromRooms(rooms=bordershades.hb_objs, grid_size="0.2")  # -> grid, points, mesh; plug-in component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
assigngridsviews = HBAssignGridsAndViews(model=model.model, grids=flatten(gridrooms.grid))  # -> model; plug-in component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
vizwiref = HBVisualizeWireframe(hb_objs=flatten(model.model))  # -> geo; plug-in component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

python = GhPythonScript()  # -> a
# ---------- python: Python ----------
import os
a = os.path.dirname(ghenv.Component.OnPingDocument().FilePath) + r'\sample_medium_grid'
# ---------- end python ----------
panel_7 = Panel(python)

# ----
# Write
# Radiance
# Model Folder
modeltorad = HBModelToRadFolder(model=assigngridsviews, folder=python, write=Toggle(False))  # -> report, folder; plug-in component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
opendir = LBOpenDirectory(file_path=modeltorad.folder)  # -> report; disabled; plug-in component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

modeltohbjson = GhPythonScript(model=assigngridsviews, folder=panel_7, write=Toggle(False))  # inputs write: Boolean
# ---------- modeltohbjson: Python ----------
if write and folder is not None:
    model.to_hbjson(folder=folder)
# ---------- end modeltohbjson ----------
